# Grasshopper definition ABB_3d-printing_template.gh (Grasshopper 1.0.7)
# plug-ins: Robots, Pufferfish, Heteroptera

# ---- group: Geometry
cir = Circle(Plane=PlaneXY(0, 0, 0), Radius=Slider(50, range=0..100))
Z = UnitZ(Factor=Slider(100, range=0..1000))
area = Area(Geometry=cir)  # -> Area, Centroid
extr = Extrude(Base=cir, Direction=Z)
contour = Contour(Shape=extr, Point=Point(0, 0, 0), Direction=Vector(0, 0, 1), Distance=Slider(4.5, range=0..10))

# ---- group: Robot settings
# MAIN SETTINGS & CALIBRATION
list = ValueList({"AA-KR60", "AA-KR30", "AA-KR60_KR30", "AARCH IRB120", "AARCH IRB6620", "Bartlett-IRB120", "Bartlett-IRB1600", "Bartlett-KR6", "Bartlett-KR60", "Bartlett-UR10", "Bigli-KR20", "ETH-Gantry", "Grymsdyke-IRB120", "Grymsdyke-KR210", "iaac-KR150-2_110", "iaac-IRB140", "iaac-IRB120", "EXArchitects-IRB6700", "KULeuven-IRB120", "KULeuven-UR5", "KULeuven-UR10", "IRB4600-205", "UEL IRB6620", "uem-IRB120", "uem-IRB1600", "uem-IRB2600", "uem-IRB1600_IRB2600", "UniMelb-IRB120", "UniMelb-IRB1200"}, selected="iaac-IRB140")
xy = XYPlane(Origin=Point(0, 0, 0))
load_robot = LoadRobotSystem(Name=list, Base=xy)

# ---- group: initial pose
merge = Merge(
    Data1=Slider(-4, range=-180..180),
    Data2=Slider(-40, range=-180..180),
    Data3=Slider(40, range=-180..180),
    Data4=Slider(0, range=-180..180),
    Data5=Slider(0, range=-180..180),
    Data6=Slider(0, range=-180..180))
degrees_to_radians = DegreesToRadians(Degrees=merge, RobotSystem=load_robot, MechanicalGroup=0)

# ---- group: Syringe tool
p_project_tcp = Panel("273.64,-1.98,79.85")
name_of_your_tool = Panel("threedpa")
pt = Point(p_project_tcp)
yz = YZPlane(Origin=pt)
pflip = FlipPlane(Plane=yz, ReverseX=False, ReverseY=False, SwapAxes=True)
prot = RotatePlane(Plane=pflip, Angle=expr("-x", degrees(Slider(20, range=-90..90))))
mesh = Mesh(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)
tool = CreateTool(Name=name_of_your_tool, TCP=prot, Weight=0, Centroid=Point(20, 0, 52), Mesh=mesh)  # -> Tool, TCP

# ----
md_slider = MDSlider(
    SliderMode=0,
    slider_value=Point(0.3306255341, 0.4456501007, 0.5),
    x_domain=Domain(0, 1),
    y_domain=Domain(0, 1),
    z_domain=Domain(0, 1))
number_slider = Slider(0.1, range=0..1)
number_slider_2 = Slider(3, range=0..10)

outline = Curve(simplify(Tree({0;0}: [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], {0;1}: [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], {0;2}: [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], {0;3}: [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], {0;4}: [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], {0;5}: [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]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)))
infill = Curve(simplify(Tree({0}: [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], {1}: [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], {2}: [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], {3}: [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], {4}: [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], {5}: [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]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)))

safty_offset = Panel("20")
printing_speed = Panel("13")
printing_speed_2 = Panel("40")
center = Center(Geometric=flatten([infill, outline]), forall=True, referenceAll=2)  # -> Center, Dimension
merge_2 = Merge(Data1=outline, Data2=infill)
zone = Panel("5")
rotate = Rotate(Geometry=merge_2, Angle=degrees(Slider(180, range=0..180)), Plane=center.Center)  # -> Geometry, Transform

# ---- group: Platform
platform_calibration = Panel("779.56,-133.07,10.92")
platform_calibration_2 = Panel("373.50,258.27,9.79")
platform_calibration_3 = Panel("776.92,260.25,11.31")
pt_2 = Point(platform_calibration_2)
pt_3 = Point(platform_calibration_3)
pt_4 = Point(platform_calibration)
rec_3pt = Rectangle3Pt(PointA=pt_3, PointB=pt_4, PointC=pt_2)  # -> Rectangle, Length
evalsrf = EvaluateSurface(Surface=reparameterize(rec_3pt.Rectangle), Point=md_slider)  # -> Point, Normal, UDirection, VDirection, Frame
move2pt = MoveToPoint(Geometry=rotate.Geometry, PointA=center.Center, PointB=evalsrf.Point)  # -> Moved, Vector, Transform
Z_2 = UnitZ(Factor="8")
move = Move(Geometry=move2pt.Moved, Motion=Z_2)  # -> Geometry, Transform
topoly = CurveToPolyline(Curve=move.Geometry, ToleranceDistance=number_slider_2, ToleranceAngle=number_slider)  # -> Polyline, Segments

# ----
cull_i = CullIndex(List=move.Geometry, Indices="0", Wrap=True)
item = ListItem(List=move.Geometry, Index="0", Wrap=True)
explode = Explode(Curve=topoly.Polyline, Recursive=True)  # -> Segments, Vertices
# CONSTRUCT PLANES
alicrvseams = AlignCurveSeams(Curves=item, Snap=False, Iterative=True)  # -> Aligned, Points, R
topoly_2 = CurveToPolyline(Curve=cull_i, ToleranceDistance=number_slider_2, ToleranceAngle=number_slider)  # -> Polyline, Segments
topoly_3 = CurveToPolyline(Curve=alicrvseams.Aligned, ToleranceDistance=number_slider_2, ToleranceAngle=number_slider)  # -> Polyline, Segments
explode_2 = Explode(Curve=topoly_2.Polyline, Recursive=True)  # -> Segments, Vertices
explode_3 = Explode(Curve=topoly_3.Polyline, Recursive=True)  # -> Segments, Vertices
pshift = ShiftPaths(Data=explode_2.Vertices, Offset=-1)
pshift_2 = ShiftPaths(Data=explode_3.Vertices, Offset=-1)
path_mapper = PathMapper(pshift, source="{a;0}", target="{a;1}")
merge_3 = Merge(Data1=path_mapper, Data2=pshift_2)

xy_2 = XYPlane(Origin=merge_3)
panel = Panel("""0
-1""")
item_2 = ListItem(List=xy_2, Index=panel, Wrap=True)
cull_i_2 = CullIndex(List=xy_2, Indices=panel, Wrap=True)
item_3 = ListItem(List=flatten(item_2), Index=0, Wrap=True)  # -> Item, Item1
item_4 = ListItem(List=item_2, Index=0, Wrap=True)  # -> Item, Item1
Z_3 = UnitZ(Factor=safty_offset)
move_2 = Move(Geometry=item_3.Item, Motion=Z_3)  # -> Geometry, Transform
move_3 = Move(Geometry=item_4.Item1, Motion=Z_3)  # -> Geometry, Transform

toolpath_planes = Plane(simplify(cull_i_2))
approach_plane = Plane(simplify(move_2.Geometry))
extrude_plane = Plane(simplify(item_4.Item))
retract_plane = Plane(simplify(move_3.Geometry))
finish_plane = Plane(simplify(item_4.Item1))

wait = Wait(Time="0.8")
setdo = SetDO(DO="9", Value="True")
setdo_2 = SetDO(DO="9", Value="False")
wait_2 = Wait(Time="0.8")
merge_4 = Merge(Data1=setdo)
merge_5 = Merge(Data1=wait_2, Data2=setdo_2)
list_2 = ValueList({"Joint", "Linear"}, selected="Linear")
# CREATE TARGETS
list_3 = ValueList({"Joint", "Linear"}, selected="Joint")
list_4 = ValueList({"Joint", "Linear"}, selected="Linear")
list_5 = ValueList({"Joint", "Linear"}, selected="Linear")
groupcmd = GroupCommand(Commands=merge_4)
groupcmd_2 = GroupCommand(Commands=merge_5)

# ---- group: Robot targets
list_6 = ValueList({"Joint", "Linear"}, selected="Linear")
target = CreateTarget(
    Plane=extrude_plane,
    Motion=list_5,
    Tool=tool.Tool,
    Speed=printing_speed_2,
    Zone=zone,
    Command=groupcmd,
    IsCartesian=True)
target_2 = CreateTarget(Plane=toolpath_planes, Motion=list_4, Tool=tool.Tool, Speed=printing_speed_2, Zone=zone, IsCartesian=True)
target_3 = CreateTarget(Plane=retract_plane, Motion=list_6, Tool=tool.Tool, Speed=printing_speed_2, Zone=zone, IsCartesian=True)
target_4 = CreateTarget(Plane=approach_plane, Motion=list_3, Tool=tool.Tool, Speed=printing_speed_2, Zone=zone, IsCartesian=True)
target_5 = CreateTarget(
    Plane=finish_plane,
    Motion=list_2,
    Tool=tool.Tool,
    Speed=printing_speed_2,
    Zone=zone,
    Command=groupcmd_2,
    IsCartesian=True)
target_6 = CreateTarget(Joints=degrees_to_radians, Tool=tool.Tool, Speed=printing_speed, Zone=zone, IsCartesian=False)

# ----
merge_6 = Merge(Data1=target, Data2=target_2, Data3=target_5, Data4=target_3)
entwine = Entwine(Branch00=target_6, Branch01=target_4, Branch02=merge_6, Branch03=target_6, FlattenInputs=True)  # -> flatten(Result)

# ----
# ROBOT SIMULATION
panel_2 = Panel("3d print")
program = CreateProgram(Name="DefaultProgram", RobotSystem=load_robot, Targets1=flatten(entwine), StepSize=1)  # -> Program, Code, Duration, Warnings, Errors
check_errors = Panel(program.Errors)
to_export_code_file_prg = Panel(program.Code)
sim = ProgramSimulation(Program=program.Program, Time=Slider(0, range=0..1), Normalized=True)  # -> SystemMeshes, JointRotations, Plane, Index, Time, Program, Errors

# ---- group: to export file
txt = Text(flatten(program.Code))
path = FilePath("C:\Users\Huanyu Li\Desktop\gcode\")
file_name = Panel("print_geo_6")
python = GhPythonScript(program=txt, path=path, name=file_name, write=Button())  # -> out, a; inputs program: list
# ---------- python: Python ----------
__author__ = "kunal"
__version__ = "2018.10.16"

import rhinoscriptsyntax as rs

if write:
    with open(path + name + '.prg', 'w') as file:
        for line in program:
            file.write(line)
            file.write('\n')
# ---------- end python ----------

# ----
# DISPLAYS
time_seconds = Panel(sim.Index)

abb_table_iaac = Geometry([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, Point(-98, 0, 0)])
preview = CustomPreview(Geometry=abb_table_iaac, Shader=ColourSwatch(SwatchColor=RGBA(178, 178, 178, 50)))

time_seconds_2 = Panel(sim.Time)

platform = Surface(rec_3pt.Rectangle)
preview_2 = CustomPreview(Geometry=platform, Shader=ColourSwatch(SwatchColor=RGBA(168, 171, 79, 174)))

geometry = Curve(topoly.Polyline)
preview_3 = CustomPreview(Geometry=geometry, Shader=ColourSwatch(SwatchColor=RGBA(0, 0, 0, 174)))

# ---- group: Display simulation
trail = SimpleTrail(Program=sim.Program, Length=500, MechanicalGroup=0)
preview_4 = CustomPreview(Geometry=trail, Shader=ColourSwatch(SwatchColor=RGB(0, 4, 255)))

# ----
deconstruct_program_targets = DeconstructProgramTargets(Program=sim.Program)  # -> Planes, Joints, Configuration, DeltaTime
flip_matrix = FlipMatrix(Data=deconstruct_program_targets.Joints)
axis_rotation = QuickGraph(flip_matrix, SortOrder=0)
