# Grasshopper definition 071122_ABB motorscrew extruder for clay.gh (Grasshopper 1.0.7)
# plug-ins: Heteroptera, Robots, Pufferfish

# ---- group: Tool Data / TCP to calibrate
panel = Panel("205.416, 2.858, 39.469")

# ----
# BASE CALIBRATION
panel_2 = Panel("693.36")
pt = ConstructPoint(XCoordinate=panel_2, YCoordinate="85.94", ZCoordinate="25.23")
pt_2 = ConstructPoint(XCoordinate="693.36", YCoordinate="-31.95", ZCoordinate="25.23")
pt_3 = ConstructPoint(XCoordinate="574.91", YCoordinate="85.94", ZCoordinate="25.23")
pt_4 = ConstructPoint(XCoordinate="574.91", YCoordinate="-33.61", ZCoordinate="25.23")
xy = XYPlane(Origin=pt)
xy_2 = XYPlane(Origin=pt_2)
xy_3 = XYPlane(Origin=pt_3)
xy_4 = XYPlane(Origin=pt_4)
number_slider = Slider(120, range=0..1000)
pline = PolyLine(Vertices=[pt_2, pt, pt_3, pt_4], Closed=True)
neg = Negative(Value=Slider(25.2, range=0..100))
Z = UnitZ(Factor=neg)
rectangle = Rectangle(Plane=PlaneXY(0, 0, 0), XSize=number_slider, YSize=number_slider, Radius=0)  # -> Rectangle, Length
move = Move(Geometry=pline, Motion=Z)  # -> Geometry, Transform
area = Area(Geometry=rectangle.Rectangle)  # -> Area, Centroid
area_2 = Area(Geometry=move.Geometry)  # -> Area, Centroid
move2pt = MoveToPoint(Geometry=rectangle.Rectangle, PointA=area.Centroid, PointB=area_2.Centroid)  # -> Moved, Vector, Transform
area_3 = Area(Geometry=move2pt.Moved)  # -> Area, Centroid

# ---- group: Tool Data
tool_center_point = Point(panel)
yz = YZPlane(Origin=tool_center_point)
pflip = FlipPlane(Plane=yz, ReverseX=False, ReverseY=False, SwapAxes=True)
name_of_your_tool = Panel("clayextruder")
motorextruder = Mesh(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)
tool = CreateTool(Name=name_of_your_tool, TCP=pflip, Weight=0, Centroid=Point(20, 0, 52), Mesh=motorextruder)  # -> Tool, TCP

# ----
list = ValueList({"AA-KR60", "AA-KR30", "AA-KR60_KR30", "AARCH IRB120", "AARCH IRB6620", "AAU-Utzon-UR10", "Automata", "Bartlett-IRB120", "Bartlett-IRB1600", "Bartlett-KR6"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}, selected="iaac-IRB140")

# ---- group: Robot Data
pt_5 = ConstructPoint(XCoordinate=0, YCoordinate=0, ZCoordinate=0)
xy_5 = XYPlane(Origin=pt_5)
load_robot = LoadRobotSystem(Name=list, Base=xy_5)

# ---- group: Robot Table display
abb_table_iaac = Geometry([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, Point(0, 0, 0)])
preview = CustomPreview(Geometry=abb_table_iaac, Shader=ColourSwatch(SwatchColor=RGBA(171, 171, 171, 22)))

# ----
speed = Panel("100")
saftey_offset_plane = Panel("50")
layer_height = Panel("1.75")

# ---- group: surface INPUT
curve = Curve(Tree({0;0}: [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], {0;1}: [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]))

# ---- group: print PLACING
bbox = BoundingBox(Content=curve, Plane=PlaneXY(0, 0, 0))  # -> Box, Box_2
debrep = DeconstructBrep(Brep=bbox.Box)  # -> Faces, Edges, Vertices
area_4 = Area(Geometry=debrep.Faces)  # -> Area, Centroid
sort = SortList(Keys=area_4.Centroid, ValuesA=debrep.Faces)  # -> Keys, ValuesA
item = ListItem(List=flatten(sort.ValuesA), Index=0, Wrap=True)
center = Center(Geometrical=item)  # -> Center, Dimension
pt_6 = Point(Point(522.1340284, -76.87212492, 0))
vec2pt = Vector2Pt(PointA=center.Center, PointB=area_3.Centroid, Unitize=False)  # -> Vector, Length
move_2 = Move(Geometry=curve, Motion=vec2pt.Vector)  # -> Geometry, Transform

# ---- group: board BASE
boardthickness = Slider(24, range=0..100)
addition = Addition(A=boardthickness, B=layer_height)
Z_2 = UnitZ(Factor=addition)

# ----
move2pt_2 = MoveToPoint(Geometry=rectangle.Rectangle, PointA=area.Centroid, PointB=area_2.Centroid)  # -> Moved, Vector, Transform
move_3 = Move(Geometry=move2pt_2.Moved, Motion=Z_2)  # -> Geometry, Transform
move_4 = Move(Geometry=move_2.Geometry, Motion=Z_2)  # -> Geometry, Transform

# ---- group: display
preview_2 = CustomPreview(Geometry=[move_4.Geometry, move_3.Geometry], Material=ColourSwatch(SwatchColor=RGBA(235, 235, 235, 23)))

# ---- group: safety offset
offset_on_off = Slider(5, range=0..100)

# ----
num = Number(offset_on_off)

# ---- group: 00 -Start | End Position
merge = Merge(Data1="0", Data2="0", Data3="0", Data4="0", Data5="0", Data6="0")
degtorad = DegreesToRadians(Degrees=merge, RobotSystem=load_robot, MechanicalGroup=0)
target = CreateTarget(Joints=degtorad, Tool=tool.Tool, Speed="60", Zone="10", IsCartesian=False)

# ----
name_of_the_program = Panel("ABB_3Dprinting")

# ---- group: simulation
number_slider_2 = Slider(0, range=0..1)

# ----
topoly = CurveToPolyline(Curve=move_4.Geometry, ToleranceDistance=".3", ToleranceAngle=0)  # -> Polyline, Segments

# ---- group: FIXING ORDER OF CURVES
cluster = Cluster(T=topoly.Polyline)

# ----
data = Data(cluster)

explode = Explode(Curve=data, Recursive=True)  # -> Segments, Vertices
xy_6 = XYPlane(Origin=explode.Vertices)

flatten = FlattenTree(Tree=xy_6, Path="{0}")

planes_flattened = Plane(flatten)
planes = Plane(xy_6)

item_2 = ListItem(List=planes, Index=0, Wrap=True)
item_3 = ListItem(List=planes, Index="-1", Wrap=True)

# ---- group: 04-last point
panel_3 = Panel("-1")
item_4 = ListItem(List=planes_flattened, Index=panel_3, Wrap=True)
list_2 = ValueList({"Joint", "Linear"}, selected="Linear")
target_2 = CreateTarget(Plane=item_4, Motion=list_2, Tool=tool.Tool, Speed=speed, Zone="5", IsCartesian=True)

# ---- group: 03-main code
panel_4 = Panel("""0
-1""")
cull_i = CullIndex(List=planes, Indices=panel_4, Wrap=True)
trim = TrimTree(Tree=cull_i, Depth=1)
list_3 = ValueList({"Joint", "Linear"}, selected="Linear")
target_3 = CreateTarget(Plane=trim, Motion=list_3, Tool=tool.Tool, Speed=speed, Zone="5", IsCartesian=True)

# ----
xy_7 = XYPlane(Origin=planes_flattened)

# ---- group: ending offset
item_5 = ListItem(List=planes_flattened, Index=panel_3, Wrap=True)
pl_offset = PlaneOffset(BasePlane=item_5, Offset=saftey_offset_plane)
list_4 = ValueList({"Joint", "Linear"}, selected="Linear")
target_4 = CreateTarget(Plane=pl_offset, Motion=list_4, Tool=tool.Tool, Speed=speed, Zone="5", IsCartesian=True)

# ---- group: 01-Starting Offset
item_6 = ListItem(List=xy_7, Index="0", Wrap=True)
pl_offset_2 = PlaneOffset(BasePlane=item_6, Offset=saftey_offset_plane)
list_5 = ValueList({"Joint", "Linear"}, selected="Joint")
target_5 = CreateTarget(Plane=pl_offset_2, Motion=list_5, Tool=tool.Tool, Speed=speed, Zone="20", IsCartesian=True)

# ---- group: extrusion on
setdo = SetDO(DO="1", Value="FALSE")
setdo_2 = SetDO(DO="9", Value="TRUE")
wait = Wait(Time=".5")
merge_2 = Merge(Data1=setdo_2, Data2=setdo, Data3=wait)
list_6 = ValueList({"Joint", "Linear"}, selected="Linear")
groupcmd = GroupCommand(Commands=merge_2)
target_6 = CreateTarget(Plane=item_2, Motion=list_6, Tool=tool.Tool, Speed="50", Zone="0", Command=groupcmd, IsCartesian=True)

# ---- group: safety offset
pl_offset_3 = PlaneOffset(BasePlane=item_3, Offset=num)
list_7 = ValueList({"Joint", "Linear"}, selected="Linear")
target_7 = CreateTarget(Plane=pl_offset_3, Motion=list_7, Tool=tool.Tool, Speed=speed, IsCartesian=True)

# ---- group: saftey offset
pl_offset_4 = PlaneOffset(BasePlane=item_2, Offset=num)
list_8 = ValueList({"Joint", "Linear"}, selected="Linear")
target_8 = CreateTarget(Plane=pl_offset_4, Motion=list_8, Tool=tool.Tool, Speed=speed, IsCartesian=True)

# ---- group: extrusion off
panel_5 = Panel("9")
panel_6 = Panel("FALSE")
setdo_3 = SetDO(DO="1", Value="TRUE")
wait_2 = Wait(Time=".2")
list_9 = ValueList({"Joint", "Linear"}, selected="Linear")

# ----
setdo_4 = SetDO(DO=panel_5, Value=panel_6)
merge_3 = Merge(Data1=setdo_4, Data2=setdo_3, Data3=wait_2)

# ---- group: extrusion off (continued)
groupcmd_2 = GroupCommand(Commands=merge_3)
target_9 = CreateTarget(Plane=item_3, Motion=list_9, Tool=tool.Tool, Speed=speed, Zone="0", Command=groupcmd_2, IsCartesian=True)

# ----
merge_4 = Merge(Data1=target_8, Data2=target_6, Data3=target_3, Data4=target_9, Data5=target_7)
data_2 = Data(merge_4)
entwine = Entwine(
    Branch00=target,
    Branch01=target_5,
    Branch02=data_2,
    Branch03=target_2,
    Branch04=target_4,
    Branch05=target,
    FlattenInputs=True)
program = CreateProgram(Name=name_of_the_program, RobotSystem=load_robot, Targets1=flatten(entwine), StepSize=1)  # -> Program, Code, Duration, Warnings, Errors
check_errors = Panel(program.Warnings)
to_export_code_to_prg_file = Panel(program.Code)
sim = ProgramSimulation(Program=program.Program, Time=number_slider_2, Normalized=True)  # -> SystemMeshes, JointRotations, Plane, Index, Time, Program, Errors

# ---- group: exporting the file
path = FilePath("D:\MRAC_2223\")
file_name = Panel("test_withbase04")
txt = Text(flatten(program.Code))
python = GhPythonScript(program=txt, path=path, name=file_name, write=Button())  # -> out, a; inputs program: list
# ---------- python: Python ----------
__author__ = "kunal"
__version__ = "2018.10.16"

import rhinoscriptsyntax as rs

if write:
    with open(path + name + '.prg', 'w') as file:
        for line in program:
            file.write(line)
            file.write('\n')
# ---------- end python ----------

# ---- group: printing time
division = Division(A=program.Duration, B=60)
round = Round(Number=division)  # -> Nearest, Floor, Ceiling
time_in_minutes = Panel(round.Nearest)

# ---- group: Display Data
trail = SimpleTrail(Program=sim.Program, Length="20000", MechanicalGroup=0)
split = SplitList(List=sim.SystemMeshes, Index="7")  # -> ListA, ListB
preview_3 = CustomPreview(Geometry=trail, Material=ColourSwatch(SwatchColor=RGB(255, 0, 195)))
preview_4 = CustomPreview(Geometry=split.ListA, Shader=ColourSwatch(SwatchColor=RGB(219, 219, 219)))
preview_5 = CustomPreview(Geometry=split.ListB, Shader=ColourSwatch(SwatchColor=RGB(135, 135, 135)))

# ==== cluster Cluster
T = ClusterInput()
flatten = FlattenTree(Tree=T, Path="{0}")
int = Integer([0, 1, 2, 3, 4, 5])
cull_i = CullIndex(List=flatten, Indices=int, Wrap=True)
series = Series(Start="6", Step=1, Count="49")
panel = Panel("""False
False
True""")
panel_2 = Panel("""True
False
False""")
panel_3 = Panel("""False
True
False""")
cull_i_2 = CullIndex(List=flatten, Indices=series, Wrap=True)
cull = CullPattern(List=cull_i_2, CullPattern=panel_2)
cull_2 = CullPattern(List=cull_i_2, CullPattern=panel_3)
cull_3 = CullPattern(List=cull_i_2, CullPattern=panel)
ins = InsertItems(List=cull_i, Item=cull, Indices="0", Wrap=True)
ins_2 = InsertItems(List=ins, Item=cull_2, Indices="2", Wrap=True)
ins_3 = InsertItems(List=ins_2, Item=cull_3, Indices="4", Wrap=True)
L = ClusterOutput(ins_3)
