# Grasshopper definition 3d print cup_Design and model.gh (Grasshopper 1.0.7)
# plug-ins: Bifocals, Mesh Pipe

layer_height = Slider(1.75, range=0..10)
print_height = Slider(90, range=0..100)
printing_width = Slider(2, range=0..10)

# ---- group: intital geometry
construct_point = ConstructPoint(XCoordinate=0, YCoordinate=0, ZCoordinate=0)
unit_z = UnitZ(Factor=print_height)
move = Move(Geometry=construct_point, Motion=unit_z)  # -> Geometry, Transform
line = Line(StartPoint=construct_point, EndPoint=move.Geometry)
divide_length = DivideLength(Curve=line, Length=layer_height)  # -> Points, Tangents, Parameters

# ---- group: shape geometry
list_length = ListLength(List=divide_length.Tangents)
xy_plane = XYPlane(Origin=divide_length.Points)
range = Range(Domain=Domain(0, 1), Steps=expr("x-1", list_length))  # -> reverse(Range)
multiplication = Multiplication(A=range, B=Slider(4.29, range=0..10))
rotate_plane = RotatePlane(Plane=xy_plane, Angle=degrees(multiplication))
graph_mapper = GraphMapper(
    divide_length.Parameters,
    x0=0,
    x1=1,
    y0=0,
    y1=1,
    container_name="Sine",
    Equation_px=[0.007954031229, 0.6571575403],
    Equation_py=[0.5415393114, 1])
multiplication_2 = Multiplication(A=graph_mapper, B=Slider(41.98, range=0..100))  # -> reverse(Result)

# ----
circle = Circle(Plane=rotate_plane, Radius=multiplication_2)

# ---- group: texture geometry
divide_curve = DivideCurve(Curve=circle, Count=Slider(26, range=0..100), Kinks=False)  # -> Points, Tangents, Parameters
polyline = PolyLine(Vertices=divide_curve.Points, Closed=invert(False))

# ----
dispatch = Dispatch(List=flatten(polyline), DispatchPattern=[True, False])  # -> ListA, ListB

explode = Explode(Curve=dispatch.ListA, Recursive=True)  # -> Segments, Vertices
perp_frames = PerpFrames(Curve=explode.Segments, Count="2", Align=True)  # -> Frames, Parameters
list_item = ListItem(List=perp_frames.Frames, Index=0, Wrap=True)  # -> Item, Item1, Item2
deconstruct_plane = DeconstructPlane(Plane=list_item.Item1)  # -> Origin, XAxis, YAxis, ZAxis
number_slider = Slider(7, range=0..10)
amplitude = Amplitude(Vector=deconstruct_plane.YAxis, Amplitude=number_slider)
move_2 = Move(Geometry=deconstruct_plane.Origin, Motion=amplitude)  # -> Geometry, Transform
merge = Merge(Data1=list_item.Item, Data2=move_2.Geometry, Data3=list_item.Item2)
interpolate = Interpolate(Vertices=merge, Degree=Slider(3, range=0..10), Periodic=False, KnotStyle=1)  # -> Curve, Length, Domain

explode_2 = Explode(Curve=dispatch.ListB, Recursive=True)  # -> Segments, Vertices
perp_frames_2 = PerpFrames(Curve=explode_2.Segments, Count="2", Align=True)  # -> Frames, Parameters
list_item_2 = ListItem(List=perp_frames_2.Frames, Index=0, Wrap=True)  # -> Item, Item1, Item2
deconstruct_plane_2 = DeconstructPlane(Plane=list_item_2.Item1)  # -> Origin, XAxis, YAxis, ZAxis
amplitude_2 = Amplitude(Vector=deconstruct_plane_2.YAxis, Amplitude=number_slider)
move_3 = Move(Geometry=deconstruct_plane_2.Origin, Motion=amplitude_2)  # -> Geometry, Transform
merge_2 = Merge(Data1=list_item_2.Item, Data2=move_3.Geometry, Data3=list_item_2.Item2)
interpolate_2 = Interpolate(Vertices=merge_2, Degree=Slider(3, range=0..10), Periodic=False, KnotStyle=1)  # -> Curve, Length, Domain

join_curves = JoinCurves(Curves=simplify(flatten(interpolate.Curve)), Preserve=False)
join_curves_2 = JoinCurves(Curves=simplify(flatten(interpolate_2.Curve)), Preserve=False)
area = Area(Geometry=join_curves_2)  # -> Area, Centroid
rotate = Rotate(Geometry=join_curves_2, Angle=degrees("90"), Plane=area.Centroid)  # -> Geometry, Transform
curve = Curve([join_curves, rotate.Geometry])

# ---- group: order curves verification
area_2 = Area(Geometry=curve)  # -> Area, Centroid
deconstruct = Deconstruct(Point=area_2.Centroid)  # -> XComponent, YComponent, ZComponent
# DESIGN
sort_list = SortList(Keys=deconstruct.ZComponent, ValuesValuesA=curve)  # -> Keys, ValuesValuesA

# ----
list_item_3 = ListItem(List=flatten(sort_list.ValuesValuesA), Index=0, Wrap=True)  # -> Item, Item1, Item2
# ROBOT FABRICATION
curve_2 = Curve(list_item_3.Item)

# ---- group: 1st base
number_slider_2 = Slider(18, range=0..100)
rebuild_curve = RebuildCurve(Curve=curve_2, Degree=Slider(10, range=0..100), Count=number_slider_2, Tangents=False)
fillet = Fillet(Curve=rebuild_curve, Radius=number_slider_2)
unit_y = UnitY(Factor=1)
contour = Contour(Shape=fillet, Point=Point(0, 0, 0), Direction=unit_y, Distance=printing_width)
dispatch_2 = Dispatch(List=flatten(contour), DispatchPattern=[True, False])  # -> ListA, ListB
flip_curve = FlipCurve(Curve=dispatch_2.ListA)  # -> Curve, Flag
weave = Weave(Pattern=[0, 1], Stream0=flip_curve.Curve, Stream1=dispatch_2.ListB, NullGaps=False)
connect_curves = ConnectCurves(Curves=weave, Continuity=2, Close=invert(True), Bulge=1)

number_slider_3 = Slider(18, range=0..100)
rebuild_curve_2 = RebuildCurve(Curve=list_item_3.Item2, Degree=Slider(10, range=0..100), Count=number_slider_3, Tangents=False)
fillet_2 = Fillet(Curve=rebuild_curve_2, Radius=number_slider_3)
unit_y_2 = UnitY(Factor=1)
contour_2 = Contour(Shape=fillet_2, Point=Point(0, 0, 0), Direction=unit_y_2, Distance=printing_width)
dispatch_3 = Dispatch(List=flatten(contour_2), DispatchPattern=[True, False])  # -> ListA, ListB
flip_curve_2 = FlipCurve(Curve=dispatch_3.ListA)  # -> Curve, Flag
weave_2 = Weave(Pattern=[0, 1], Stream0=flip_curve_2.Curve, Stream1=dispatch_3.ListB, NullGaps=False)
connect_curves_2 = ConnectCurves(Curves=weave_2, Continuity=2, Close=invert(True), Bulge=1)

# ----
unit_x = UnitX(Factor=1)

# ---- group: 1st base
number_slider_4 = Slider(18, range=0..100)
rebuild_curve_3 = RebuildCurve(Curve=list_item_3.Item1, Degree=Slider(10, range=0..100), Count=number_slider_4, Tangents=False)
fillet_3 = Fillet(Curve=rebuild_curve_3, Radius=number_slider_4)
contour_3 = Contour(Shape=fillet_3, Point=Point(0, 0, 0), Direction=unit_x, Distance=printing_width)
dispatch_4 = Dispatch(List=flatten(contour_3), DispatchPattern=[True, False])  # -> ListA, ListB
flip_curve_3 = FlipCurve(Curve=dispatch_4.ListA)  # -> Curve, Flag
weave_3 = Weave(Pattern=[0, 1], Stream0=flip_curve_3.Curve, Stream1=dispatch_4.ListB, NullGaps=False)
connect_curves_3 = ConnectCurves(Curves=weave_3, Continuity=2, Close=invert(True), Bulge=1)

# ----
curve_3 = Curve(sort_list.ValuesValuesA)
trim_tree = TrimTree(Tree=curve_3, Depth=expr("1", 1))

# ---- group: BASE PRINTING CRV
merge_3 = Merge(Data1=connect_curves, Data2=connect_curves_3, Data3=connect_curves_2)

# ----
entwine = Entwine(Branch00=merge_3, Branch01=trim_tree, FlattenInputs=True)

# ---- group: display
division = Division(A=printing_width, B="2")
mesh_pipe = MeshPipe(Curve=entwine, Radius=division, Accuracy=0.2, Rotation=0, Segments=10, Caps=2)
custom_preview = CustomPreview(Geometry=mesh_pipe, Material=ColourSwatch(SwatchColor=RGB(199, 46, 255)))
