# Grasshopper definition AM_nonplanarprintoversupport_wavetile_PancakeEmergency.23_06_28_08_00_12.gh (Grasshopper 1.0.7)
# plug-ins: Robots, gHowl, FologramForGrasshopper, Heteroptera, treesloth01, Pufferfish, Weaverbird, Human

# INPUT DATA
panel = Panel("192.168.10.21")

# ---- group: python to gh points
data = Data("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")
split = TextSplit(Text=data, Separators="[]")
len = TextLength(Text=split)
larger = LargerThan(FirstNumber=len, SecondNumber=0)  # -> LargerThan, OrEqualTo
dispatch = Dispatch(List=split, DispatchPattern=larger.LargerThan)  # -> ListA, ListB
trim = TextTrim(Text=dispatch.ListA, Start=" ", End=True)
# 0_client-serverModel
panel_2 = Panel(",")
rep = ReplaceText(Text=trim, Find=" ", Replace=panel_2, RecursiveReplace=False)
len_2 = TextLength(Text=rep)
larger_2 = LargerThan(FirstNumber=len_2, SecondNumber=0)  # -> LargerThan, OrEqualTo
dispatch_2 = Dispatch(List=rep, DispatchPattern=larger_2.LargerThan)  # -> ListA, ListB
split_2 = TextSplit(Text=dispatch_2.ListA, Separators=panel_2)
len_3 = TextLength(Text=split_2)
larger_3 = LargerThan(FirstNumber=len_3, SecondNumber=0)  # -> LargerThan, OrEqualTo
dispatch_3 = Dispatch(List=split_2, DispatchPattern=larger_3.LargerThan)  # -> ListA, ListB
item = ListItem(List=dispatch_3.ListA, Index=0, Wrap=True)  # -> simplify(Item), simplify(Item1)
pt = ConstructPoint(XCoordinate=item.Item, YCoordinate=item.Item1, ZCoordinate=0)  # -> flatten(Point)

# ----
# Client Server Model
udp = UDPReceiver(Address=panel, Port="5000", Pattern=0)  # -> Info, Data
rec = DataRecorder(udp.Data, DataLimit=1, RecordData=True)
split_3 = TextSplit(Text=rec, Separators=",")
item_2 = ListItem(List=split_3, Index=0, Wrap=True)  # -> Item, Item1
split_4 = TextSplit(Text=item_2.Item, Separators="[] ")
split_5 = TextSplit(Text=item_2.Item1, Separators="[] ")
num = Number(split_4)
num_2 = Number(split_5)
clean = CleanTree(RemoveNulls=True, RemoveInvalid=True, RemoveEmpty=invert(False), Tree=num)
clean_2 = CleanTree(RemoveNulls=True, RemoveInvalid=True, RemoveEmpty=invert(False), Tree=num_2)
item_3 = ListItem(List=clean, Index=0, Wrap=True)  # -> Item, Item1
dispatch_4 = Dispatch(List=clean_2, DispatchPattern=[True, False])  # -> ListA, ListB
remap = RemapNumbers(Value=dispatch_4.ListB, Source="0 to 500", Target="0 to 250")  # -> Mapped, Clipped
remap_2 = RemapNumbers(Value=item_3.Item, Source="0 to 1000", Target="0 to 500")  # -> Mapped, Clipped
remap_3 = RemapNumbers(Value=item_3.Item1, Source="0 to 500", Target="0 to 250")  # -> Mapped, Clipped
remap_4 = RemapNumbers(Value=dispatch_4.ListA, Source="0 to 1000", Target="0 to 500")  # -> Mapped, Clipped
pt_2 = ConstructPoint(XCoordinate=remap_4.Mapped, YCoordinate=expr("250-x", remap.Mapped), ZCoordinate=0)
rectangle = Rectangle(Plane=PlaneXY(0, 0, 0), XSize="0 to 500", YSize="0 to 250", Radius=0)  # -> Rectangle, Length
pt_3 = ConstructPoint(XCoordinate=remap_2.Mapped, YCoordinate=expr("250-x", remap_3.Mapped), ZCoordinate=0)
item_4 = ListItem(List=pt_2, Index=0, Wrap=True)  # -> Item, Item1
number_slider = Slider(2, range=0..10)
number_slider_2 = Slider(3, range=0..100)
vec2pt = Vector2Pt(PointA=pt_3, PointB=item_4.Item, Unitize=False)  # -> unitize(Vector), Length
vec2pt_2 = Vector2Pt(PointA=item_4.Item1, PointB=pt_3, Unitize=False)  # -> unitize(Vector), Length
multiplication = Multiplication(A=vec2pt.Vector, B=number_slider)
multiplication_2 = Multiplication(A=vec2pt_2.Vector, B=number_slider_2)
vdis = VectorDisplay(Anchor=pt_3, Vector=vec2pt.Vector)
panel_3 = Panel(item.Item)
addition = Addition(A=multiplication_2, B=multiplication)
move = Move(Geometry=item_4.Item, Motion=addition)  # -> Geometry, Transform
align = AlignPlane(Plane=move.Geometry, Direction=vec2pt.Vector)  # -> Plane, Angle
disc = Discontinuity(Curve=rectangle.Rectangle, Level=1)  # -> Points, Parameters
pflip = FlipPlane(Plane=align.Plane, ReverseX=False, ReverseY=invert(False), SwapAxes=True)
rectangle_2 = Rectangle(Plane=pflip, XSize="0 to 20", YSize="0 to 100", Radius=0)  # -> Rectangle, Length
item_5 = ListItem(List=disc.Points, Index=0, Wrap=True)
merge = Merge(Data1=rectangle_2.Rectangle, Data2=rectangle.Rectangle)  # -> flatten(Result)
xy = XYPlane(Origin=item_5)

# ---- group: Robot settings
# MAIN SETTINGS & CALIBRATION
list = RobotsLibrary(
    {"AA-KR60", "AA-KR30", "AA-KR60_KR30", "AARCH IRB120", "AARCH IRB6620", "AARCH IRB120", "AARCH IRB6620", "AAU-Utzon-UR10", "Automata", "Bartlett-IRB120"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}, selected="iaac-IRB140",
    Type=0)
xy_2 = XYPlane(Origin=Point(0, 0, 0))
load_robot = LoadRobotSystem(Name=list, Base=xy_2)

# ---- group: Syringe tool
p_project_tcp = Panel("212.313,-1.118,34.4811")
pt_4 = Point(p_project_tcp)
yz = YZPlane(Origin=pt_4)
number_slider_3 = Slider(20, range=-90..90)
pflip_2 = FlipPlane(Plane=yz, ReverseX=False, ReverseY=False, SwapAxes=True)
prot = RotatePlane(Plane=pflip_2, Angle=expr("-x", degrees(number_slider_3)))
motorextruder = Mesh(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)
mesh = Mesh(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)
tool = CreateTool(Name="DefaultGHTool", TCP=prot, Weight=0, Centroid=Point(20, 0, 52), Mesh=motorextruder)  # -> Tool, TCP

# ---- group: initial pose
number_slider_4 = Slider(0, range=-180..180)
number_slider_5 = Slider(-40, range=-180..180)
number_slider_6 = Slider(40, range=-180..180)
number_slider_7 = Slider(0, range=-180..180)
number_slider_8 = Slider(0, range=-180..180)
number_slider_9 = Slider(0, range=-180..180)
merge_2 = Merge(
    Data1=number_slider_4,
    Data2=number_slider_5,
    Data3=number_slider_6,
    Data4=number_slider_7,
    Data5=number_slider_8,
    Data6=number_slider_9)
degtorad = DegreesToRadians(Degrees=merge_2, RobotSystem=load_robot, MechanicalGroup=0)

# ----
md_slider = MDSlider(
    SliderMode=0,
    slider_value=Point(0.5041794777, 0.471830368, 0.5),
    x_domain=Domain(0, 1),
    y_domain=Domain(0, 1),
    z_domain=Domain(0, 1))

# ---- group: Platform
platform_calibration = Panel("700.61,299.78,7.04")
platform_calibration_2 = Panel("704.15,-200.08,6.79")
platform_calibration_3 = Panel("449.97,297.37,5.77")
pt_5 = Point(platform_calibration_2)
pt_6 = Point(platform_calibration)
pt_7 = Point(platform_calibration_3)
rec_3pt = Rectangle3Pt(PointA=pt_7, PointB=pt_6, PointC=pt_5)  # -> Rectangle, Length
evalsrf = EvaluateSurface(Surface=reparameterize(rec_3pt.Rectangle), Point=md_slider)  # -> Point, Normal, UDirection, VDirection, Frame

# ----
safty_offset = Panel("20")
printing_speed = Panel("35")
printing_speed_2 = Panel("100")
panel_4 = Panel("claydonttouch")
disc_2 = Discontinuity(Curve=rec_3pt.Rectangle, Level=1)  # -> Points, Parameters
# TOOLPATH
zone = Panel("1")
item_6 = ListItem(List=disc_2.Points, Index=2, Wrap=True)
xy_3 = XYPlane(Origin=item_6)
rotate = Rotate(Geometry=xy_3, Angle=1.570796327, Plane=xy_3)  # -> Geometry, Transform
orient = Orient(Geometry=merge, Source=xy, Target=rotate.Geometry)  # -> Geometry, Transform
item_7 = ListItem(List=orient.Geometry, Index=0, Wrap=True)  # -> Item1, Item
boundary = BoundarySurfaces(Edges=item_7.Item1)

# ---- group: FAILS
number_slider_10 = Slider(1.5, range=0..4)
brep = Brep(<brep referenced from the Rhino model>)
contour = Contour(Shape=brep, Point=Point(0, 0, 0), Direction=Vector(0, 0, 1), Distance=number_slider_10)
number_slider_11 = Slider(0.3, range=0..10)
topoly = CurveToPolyline(Curve=contour, ToleranceDistance=number_slider_11, ToleranceAngle=0)  # -> Polyline, Segments
explode = Explode(Curve=topoly.Polyline, Recursive=True)  # -> Segments, flatten(Vertices)
xy_4 = XYPlane(Origin=explode.Vertices)
prot_2 = RotatePlane(Plane=xy_4, Angle=degrees("45"))
rot3d = Rotate3D(Geometry=xy_4, Angle=degrees("0"), Center=xy_4, Axis="{1,0,0}")  # -> Geometry, Transform

# ----
crv = Curve([<curve referenced from the Rhino model> x12])  # disabled
shift = ShiftList(List=crv, Shift=-1, Wrap=invert(True))  # disabled
crv_2 = Curve(<curve referenced from the Rhino model>)  # disabled
geo = Geometry(<brep referenced from the Rhino model>)  # disabled
merge_3 = Merge(Data1=flatten(shift), Data2=flatten(crv_2))  # disabled
join = BrepJoin(Breps=geo)  # -> Breps, Closed; disabled
center = Center(Geometric=geo, forall=True, referenceAll=2)  # -> Center, Dimension; disabled
project = Project(Curve=merge_3, Brep=join.Breps, Direction=Vector(0, 0, 1))  # -> simplify(Curve); disabled
rotate_2 = Rotate(Geometry=project, Angle=degrees(180), Plane=center.Center)  # -> Geometry, Transform; disabled
panel_5 = Panel("3")  # disabled
panel_6 = Panel("2.5")  # disabled
entwine = Entwine(Branch01=rotate_2.Geometry, Branch02=project, FlattenInputs=True)  # disabled
series = Series(Start=panel_6, Step=panel_6, Count=panel_5)  # disabled
Z = UnitZ(Factor=series)  # disabled
move_2 = Move(Geometry=entwine, Motion=graft(Z))  # -> simplify(graft(Geometry)), Transform; disabled
panel_7 = Panel("2.5")  # disabled
Z_2 = UnitZ(Factor=panel_7)  # disabled
move_3 = Move(Motion=Z_2)  # -> Geometry, Transform; disabled
number_slider_12 = Slider(0.2, range=0..1)  # disabled
number_slider_13 = Slider(0.01, range=0..0.01)  # disabled
topoly_2 = CurveToPolyline(Curve=move_2.Geometry, ToleranceDistance=number_slider_12, ToleranceAngle=number_slider_13)  # -> Polyline, Segments; disabled
explode_2 = Explode(Curve=topoly_2.Polyline, Recursive=True)  # -> Segments, simplify(Vertices); disabled
xy_5 = XYPlane(Origin=explode_2.Vertices)  # disabled
number_slider_14 = Slider(0.1, range=0..1)
number_slider_15 = Slider(0.1, range=0..0.1)
number_slider_16 = Slider(0.05, range=0..0.1)
number_slider_17 = Slider(0.1, range=0..1)
number_slider_18 = Slider(2, range=0..10)
number_slider_19 = Slider(1.5, range=0..10)
Z_3 = UnitZ(Factor=number_slider_19)
number_slider_20 = Slider(2.5, range=0..10)
number_slider_21 = Slider(3, range=0..10)
number_slider_22 = Slider(2, range=0..10)

# ---- group: extrusion on
setdo = SetDO(DO="1", Value="TRUE")
setdo_2 = SetDO(DO="9", Value="TRUE")
wait = Wait(Time=".5")
merge_4 = Merge(Data1=setdo, Data2=setdo_2)

# ----
setdo_3 = SetDO(DO="1", Value="FALSE")
setdo_4 = SetDO(DO="9", Value="FALSE")
wait_2 = Wait(Time="0.5")
merge_5 = Merge(Data1=wait_2, Data2=setdo_3, Data3=setdo_4)

list_2 = ValueList({"Joint", "Linear"}, selected="Linear")
# CREATE TARGETS
list_3 = ValueList({"Joint", "Linear"}, selected="Joint")
list_4 = ValueList({"Joint", "Linear"}, selected="Linear")
list_5 = ValueList({"Joint", "Linear"}, selected="Linear")
groupcmd = GroupCommand(Commands=merge_4)

abb_table_iaac = Geometry([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, Point(-98, 0, 0)])
preview = CustomPreview(Geometry=abb_table_iaac, Shader=ColourSwatch(SwatchColor=RGBA(178, 178, 178, 50)))

platform = Surface(rec_3pt.Rectangle)
preview_2 = CustomPreview(Geometry=platform, Shader=ColourSwatch(SwatchColor=RGBA(217, 217, 217, 174)))

geometry = Curve()
preview_3 = CustomPreview(Geometry=geometry, Shader=ColourSwatch(SwatchColor=RGBA(0, 0, 0, 174)))

devices = ConnectedDevices(device_filter=1, hasSerializedData=True)
# AR VIZ
syncparams = SyncParameters(
    augmented_trigger_102_key=number_slider_25,
    augmented_trigger_104_key=number_slider_23,
    augmented_trigger_108_key=number_slider_24,
    augmented_trigger_111_key=number_slider_26,
    augmented_trigger_112_key=number_slider_27,
    augmented_trigger_115_key=number_slider_12,
    augmented_trigger_116_key=number_slider_13,
    augmented_trigger_121_key=number_slider_14,
    augmented_trigger_122_key=number_slider_15,
    augmented_trigger_123_key=number_slider_16,
    augmented_trigger_124_key=number_slider_21,
    augmented_trigger_125_key=number_slider_20,
    augmented_trigger_129_key=number_slider_2,
    augmented_trigger_131_key=number_slider,
    augmented_trigger_134_key=number_slider_11,
    augmented_trigger_135_key=number_slider_10,
    augmented_trigger_136_key=number_slider_19,
    augmented_trigger_137_key=number_slider_22,
    augmented_trigger_138_key=number_slider_17,
    augmented_trigger_140_key=number_slider_18,
    augmented_trigger_68_key=number_slider_28,
    augmented_trigger_69_key=button,
    augmented_trigger_70_key=list_3,
    augmented_trigger_71_key=list_5,
    augmented_trigger_72_key=list_2,
    augmented_trigger_73_key=list_4,
    augmented_trigger_74_key=number_slider_4,
    augmented_trigger_75_key=number_slider_5,
    augmented_trigger_76_key=number_slider_6,
    augmented_trigger_77_key=number_slider_7,
    augmented_trigger_78_key=number_slider_8,
    augmented_trigger_79_key=number_slider_9,
    augmented_trigger_80_key=list_6,
    augmented_trigger_81_key=number_slider_3,
    augmented_trigger_82_key=list,
    componentVersion=1,
    num_augmented_triggers=141)
sync = SyncObject(
    AlwaysIncludeTextureCoordinates=False,
    Clickable=False,
    DefaultCurveThicknessMillimeters=2.5,
    DefaultGlossPercent=0,
    DefaultMaterialColor=RGBA(255, 0, 0, 108),
    DefaultSpecularPercent=0,
    Grabbable=False,
    Interactive=False,
    Occlusion=False,
    Outline=False,
    hasSerializedData=True)
sync_2 = SyncObject(
    AlwaysIncludeTextureCoordinates=False,
    Clickable=False,
    DefaultCurveThicknessMillimeters=2.5,
    DefaultGlossPercent=0,
    DefaultMaterialColor=RGBA(255, 255, 255, 108),
    DefaultSpecularPercent=0,
    Grabbable=False,
    Interactive=False,
    Occlusion=False,
    Outline=False,
    TextureFileName="G:\My Drive\GILLES WS\03_Algorithm\gh\material\1522677_621663824559906_1024057622_o.jpg",
    hasSerializedData=True)
device = TrackDevice(Device=devices, hasSerializedData=True, update_mode=1)

number_slider_23 = Slider(2.5, range=0..10)
number_slider_24 = Slider(58, range=0..100)
number_slider_25 = Slider(7, range=0..10)
number_slider_26 = Slider(20, range=0..100)
number_slider_27 = Slider(2.5, range=0..10)
crv_3 = Curve(<curve referenced from the Rhino model>)
disc_3 = Discontinuity(Curve=crv_3, Level=1)  # -> Points, Parameters
area = Area(Geometry=crv_3)  # -> Area, Centroid
cir = Circle(Plane=disc_3.Points, Radius=number_slider_24)
rdiff = RegionDifference(CurvesA=crv_3, CurvesB=cir)
explode_3 = Explode(Curve=rdiff, Recursive=True)  # -> Segments, Vertices
cp = ControlPoints(Curve=graft(explode_3.Segments))  # -> Points, Weights, Knots
item_8 = ListItem(List=cp.Points, Index=0, Wrap=True)  # -> Item1, Item, Item1_2
vec2pt_3 = Vector2Pt(PointA=item_8.Item1_2, PointB=area.Centroid, Unitize=False)  # -> unitize(Vector), Length
multiplication_3 = Multiplication(A=vec2pt_3.Vector, B=number_slider_25)
move_4 = Move(Geometry=item_8.Item1_2, Motion=multiplication_3)  # -> Geometry, Transform
merge_6 = Merge(Data1=item_8.Item, Data2=move_4.Geometry, Data3=item_8.Item1)
nurbs = NurbsCurve(Vertices=merge_6, Degree="2", Periodic=False)  # -> Curve, Length, Domain
X = UnitX(Factor=1)
join_2 = JoinCurves(Curves=flatten(nurbs.Curve), Preserve=False)
boundary_2 = BoundarySurfaces(Edges=crv_3)
srfsplit = SurfaceSplit(Surface=boundary_2, Curves=join_2)
disc_4 = Discontinuity(Curve=join_2, Level=1)  # -> Points, Parameters
pull = PullPoint(Point=disc_4.Points, Geometry=crv_3, ClosestOnly=True)  # -> ClosestPoint, Distance
item_9 = ListItem(List=srfsplit, Index=0, Wrap=True)
item_10 = ListItem(List=disc_3.Points, Index=0, Wrap=True)
ln = Line(StartPoint=disc_4.Points, EndPoint=pull.ClosestPoint)
srfsplit_2 = SurfaceSplit(Surface=item_9, Curves=ln)
item_11 = ListItem(List=srfsplit_2, Index=0, Wrap=True)
explode_4 = Explode(Curve=item_11, Recursive=True)  # -> Segments, Vertices
panel_8 = Panel("""2
3""")
shift_2 = ShiftList(List=explode_4.Segments, Shift=2, Wrap=True)
partition = PartitionList(List=shift_2, Size=panel_8)
join_3 = JoinCurves(Curves=partition, Preserve=False)  # -> flatten(Curves)
item_12 = ListItem(List=join_3, Index=0, Wrap=True)  # -> Item, Item1
srf = Surface(<surface referenced from the Rhino model>)
disc_5 = Discontinuity(Curve=item_12.Item, Level=1)  # -> Points, Parameters
item_13 = ListItem(List=disc_5.Points, Index=0, Wrap=True)  # -> Item, Item1
cir_2 = Circle(Plane=item_13.Item1, Radius=number_slider_23)
trim_2 = TrimWithRegion(Curve=cir_2, Region=item_12.Item)  # -> Inside, Outside
item_14 = ListItem(List=reverse(trim_2.Outside), Index=0, Wrap=True)  # -> Item, Item1
range = Range(Domain=Domain(0, 1), Steps=number_slider_26)
yz_2 = YZPlane(Origin=area.Centroid)
xz = XZPlane(Origin=area.Centroid)
series_2 = Series(Start="2", Step="2", Count="4")
Z_4 = UnitZ(Factor=series_2)

explode_5 = Explode(Curve=crv_3, Recursive=True)  # -> Segments, Vertices
dispatch_5 = Dispatch(List=explode_5.Segments, DispatchPattern=[True, False])  # -> ListA, ListB
midpt = CurveMiddle(Curve=dispatch_5.ListA)
midpt_2 = CurveMiddle(Curve=dispatch_5.ListB)
item_15 = ListItem(List=midpt, Index=0, Wrap=True)  # -> Item, Item1
item_16 = ListItem(List=midpt_2, Index=0, Wrap=True)  # -> Item, Item1
vec2pt_4 = Vector2Pt(PointA=item_16.Item, PointB=item_16.Item1, Unitize=False)  # -> Vector, Length
vec2pt_5 = Vector2Pt(PointA=item_15.Item, PointB=item_15.Item1, Unitize=False)  # -> Vector, Length
offset_l = OffsetCurveLoose(Curve=item_12.Item1, Distance=expr("-0.5*x", number_slider_23))
crv_4 = Curve(item_14.Item1)
padjust = AdjustPlane(Plane=yz_2, Normal=vec2pt_5.Vector)
padjust_2 = AdjustPlane(Plane=xz, Normal=vec2pt_4.Vector)

contour_2 = Contour(Shape=item_9, Point=item_10, Direction=vec2pt_4.Vector, Distance=number_slider_23)
shift_3 = ShiftList(List=contour_2, Shift=1, Wrap=invert(True))  # -> flatten(List)
item_17 = ListItem(List=contour_2, Index=0, Wrap=True)  # -> flatten(Item)
dispatch_6 = Dispatch(List=item_17, DispatchPattern=[True, False])  # -> ListA, ListB
dispatch_7 = Dispatch(List=shift_3, DispatchPattern=[True, False])  # -> ListA, ListB
flip = FlipCurve(Curve=dispatch_6.ListB)  # -> Curve, Flag
flip_2 = FlipCurve(Curve=dispatch_7.ListB)  # -> Curve, Flag
weave = Weave(Pattern=[0, 1], Stream0=dispatch_6.ListA, Stream1=flip.Curve, NullGaps=False)
weave_2 = Weave(Pattern=[0, 1], Stream0=dispatch_7.ListA, Stream1=flip_2.Curve, NullGaps=False)
connect = ConnectCurves(Curves=weave, Continuity=0, Close=invert(True), Bulge=1)
connect_2 = ConnectCurves(Curves=weave_2, Continuity=0, Close=invert(True), Bulge=1)
merge_7 = Merge(Data1=connect, Data2=connect_2)
rotate_3 = Rotate(Geometry=merge_7, Angle=degrees(90), Plane=area.Centroid)  # -> Geometry, Transform
tweencrv = TweenCurve(CurveA=item_14.Item1, CurveB=offset_l, Factor=range, BlendType=0)
dispatch_8 = Dispatch(List=tweencrv, DispatchPattern=[True, False])  # -> ListA, ListB
flip_3 = FlipCurve(Curve=dispatch_8.ListB)  # -> Curve, Flag
weave_3 = Weave(Pattern=[0, 1], Stream0=dispatch_8.ListA, Stream1=flip_3.Curve, NullGaps=False)
connect_3 = ConnectCurves(Curves=weave_3, Continuity=0, Close=invert(True), Bulge=1)
mirror = Mirror(Geometry=connect_3, Plane=padjust)  # -> Geometry, Transform
flip_4 = FlipCurve(Curve=graft(mirror.Geometry))  # -> Curve, Flag
connect_4 = ConnectCurves(Curves=[connect_3, flip_4.Curve], Continuity=0, Close=invert(True), Bulge=1)
mirror_2 = Mirror(Geometry=connect_4, Plane=padjust_2)  # -> Geometry, Transform
project_2 = Project(Curve=merge_7, Brep=srf, Direction=Vector(0, 0, 1))  # -> flatten(Curve)
project_3 = Project(Curve=rotate_3.Geometry, Brep=srf, Direction=Vector(0, 0, 1))  # -> flatten(Curve)

flip_5 = FlipCurve(Curve=mirror_2.Geometry)  # -> Curve, Flag
entwine_2 = Entwine(Branch00=project_3, FlattenInputs=True)
topoly_3 = CurveToPolyline(Curve=project_3, ToleranceDistance=number_slider_14, ToleranceAngle=number_slider_15)  # -> Polyline, Segments
explode_6 = Explode(Curve=topoly_3.Polyline, Recursive=True)  # -> Segments, simplify(Vertices)

merge_8 = Merge(Data1=connect_4, Data2=flip_5.Curve)
project_4 = Project(Curve=merge_8, Brep=srf, Direction=Vector(0, 0, 1))  # -> flatten(Curve)
entwine_3 = Entwine(Branch00=project_3, Branch01=project_2, Branch02=project_3, Branch03=project_4, FlattenInputs=True)

crv_5 = Curve(entwine_3)
move_5 = Move(Geometry=crv_5, Motion=graft(Z_4))  # -> Geometry, Transform
end = EndPoints(Curve=move_5.Geometry)  # -> Start, End
pframes = PerpFrames(Curve=move_5.Geometry, Count="2", Align=True)  # -> Frames, Parameters
topoly_4 = CurveToPolyline(Curve=move_5.Geometry, ToleranceDistance=0, ToleranceAngle=number_slider_17, MaxEdge=number_slider_18)  # -> Polyline, Segments
explode_7 = Explode(Curve=move_5.Geometry, Recursive=True)  # -> Segments, Vertices
item_18 = ListItem(List=pframes.Frames, Index=0, Wrap=True)
rectangle_3 = Rectangle(Plane=item_18, XSize=" -1.25 to 1.25", YSize=" -0.75 to 0.75", Radius=0)  # -> Rectangle, Length
extr = Extrude(Base=move_5.Geometry, Direction=Z_3)
divlength = DivideLength(Curve=entwine_3, Length=number_slider_20)  # -> Points, Tangents, Parameters
trim_3 = TrimTree(Tree=rectangle_3.Rectangle, Depth=1)
swp1 = Sweep1(Rail=graft(move_5.Geometry), Sections=graft(trim_3), Miter=1)
brep_cp = BrepClosestPoint(Point=divlength.Points, Brep=srf)  # -> Point, Normal, Distance
offmsh = OffsetMesh(Mesh=extr, Distance=number_slider_22, BothSides=expr("-x", number_slider_22), CreateSolid=True)  # -> flatten(Offset)

xy_6 = XYPlane(Origin=divlength.Points)

mjoin = MeshJoin(Meshes=offmsh)
padjust_3 = AdjustPlane(Plane=xy_6, Normal=brep_cp.Normal)
wbcatmullclark = WeaverbirdsCatmullClarkSubdivision(MeshCurves=offmsh, Level=1, SmoothNakedEdges=1)
preview_4 = CustomPreview(Geometry=wbcatmullclark, Material=ColourSwatch(SwatchColor=RGB(224, 107, 83)))  # disabled
shift_4 = ShiftPaths(Data=xy_6, Offset=-1)
move_6 = Move(Geometry=shift_4, Motion=simplify(graft(Z_4)))  # -> Geometry, Transform
unflatten = UnflattenTree(Tree=move_6.Geometry, Guide=xy_6)

panel_9 = Panel("""0
-1""")
item_19 = ListItem(List=move_6.Geometry, Index=panel_9, Wrap=True)
# CONSTRUCT PLANES
cull_i = CullIndex(List=move_6.Geometry, Indices=panel_9, Wrap=True)
item_20 = ListItem(List=item_19, Index=0, Wrap=True)  # -> Item, Item1
item_21 = ListItem(List=item_19, Index=0, Wrap=True)  # -> Item, Item1
Z_5 = UnitZ(Factor=safty_offset)
move_7 = Move(Geometry=item_20.Item1, Motion=Z_5)  # -> Geometry, Transform
move_8 = Move(Geometry=item_21.Item, Motion=Z_5)  # -> Geometry, Transform

extrude_plane = Plane(simplify(item_20.Item))
finish_plane = Plane(simplify(item_20.Item1))
retract_plane = Plane(simplify(move_7.Geometry))
approach_plane = Plane(simplify(move_8.Geometry))
toolpath_planes = Plane(simplify(cull_i))

# ---- group: Robot targets
list_6 = ValueList({"Joint", "Linear"}, selected="Joint")
groupcmd_2 = GroupCommand(Commands=merge_5)
target = CreateTarget(Plane=finish_plane, Motion=list_2, Tool=tool.Tool, Speed=printing_speed, Zone=zone, Command=groupcmd_2, IsCartesian=True)
target_2 = CreateTarget(Plane=extrude_plane, Motion=list_5, Tool=tool.Tool, Speed=printing_speed, Zone=zone, Command=groupcmd, IsCartesian=True)
target_3 = CreateTarget(Plane=toolpath_planes, Motion=list_4, Tool=tool.Tool, Speed=printing_speed, Zone=zone, IsCartesian=True)
target_4 = CreateTarget(Plane=retract_plane, Motion=list_6, Tool=tool.Tool, Speed=printing_speed, Zone=zone, IsCartesian=True)
target_5 = CreateTarget(Plane=approach_plane, Motion=list_3, Tool=tool.Tool, Speed=printing_speed_2, Zone=zone, IsCartesian=True)
target_6 = CreateTarget(Joints=degtorad, Tool=tool.Tool, Speed=printing_speed_2, Zone=zone, IsCartesian=False)

# ----
merge_9 = Merge(Data1=target_5, Data2=target_2, Data3=target_3, Data4=target, Data5=target_4)
entwine_4 = Entwine(Branch00=target_6, Branch01=merge_9, Branch02=target_6, FlattenInputs=True)

program = CreateProgram(Name="DefaultProgram", RobotSystem=load_robot, Targets=flatten(entwine_4), StepSize=1)  # -> Program, Code, Duration, Warnings, Errors
# ROBOT SIMULATION
panel_10 = Panel("3d print")
check_errors = Panel(program.Errors)
to_export_code_file_prg = Panel(program.Code)
number_slider_28 = Slider(1, range=0..1)
sim = ProgramSimulation(Program=program.Program, Time=number_slider_28, Normalized=True)  # -> SystemMeshes, JointRotations, Plane, Index, Time, Program, Errors

# ---- group: to export file
file_name = Panel("fail10")
button = Button()
txt = Text(flatten(program.Code))
path = FilePath("E:\robot_prints\")
python = GhPythonScript(program=txt, path=path, name=file_name, write=button)  # -> out, a; inputs program: list
# ---------- python: Python ----------
__author__ = "kunal"
__version__ = "2018.10.16"

import rhinoscriptsyntax as rs

if write:
    with open(path + name + '.prg', 'w') as file:
        for line in program:
            file.write(line)
            file.write('\n')
# ---------- end python ----------

# ----
time_seconds = Panel(sim.Time)
# DISPLAYS
time_seconds_2 = Panel(sim.Index)

decprogtarg = DeconstructProgramTargets(Program=sim.Program)  # -> Planes, Joints, Configuration, DeltaTime
flip_6 = FlipMatrix(Data=decprogtarg.Joints)
axis_rotation = QuickGraph(flip_6, SortOrder=0)

division = Division(A=time_seconds, B=60)
panel_11 = Panel(division)

# ---- group: Display simulation
trail = SimpleTrail(Program=sim.Program, Length=10000, MechanicalGroup=0)

# ----
crv_6 = Curve(trail)

# ---- group: Display simulation (continued)
previewlw = CustomPreviewLineweights(Geometry=crv_6, Shader=ColourSwatch(SwatchColor=RGB(0, 4, 255)), Absolute=False)
